# Dynamo graph lesson_01.dyn (Dynamo 2.5.0.7460)

integer_slider = IntegerSlider(8, range=0..100 step 2)
number_slider = DoubleSlider(5.252, range=0..100 step 0.001)
number_slider_2 = DoubleSlider(5.4, range=0..100 step 0.1)
byCoordinates = Point.ByCoordinates(x=number_slider_2, y=number_slider_2, z=number_slider_2)
integer_slider_2 = IntegerSlider(0, range=0..100 step 1)
byCoordinates_2 = Point.ByCoordinates(x=integer_slider_2, y=integer_slider_2, z=integer_slider_2)
byStartPointEndPoint = Line.ByStartPointEndPoint(startPoint=byCoordinates, endPoint=byCoordinates_2)
